% Simulink data dictionary embeddedBoard_common.sldd

GlobalConfiguration = Simulink.Bus()
  estimation: Bus: EstimationConfiguration

ExternalFlags = Simulink.Bus()
  fault_button: boolean  % External Fault Button (1 == pressed)

ControlOuterOutputs = Simulink.Bus()
  vel_en: boolean
  cur_en: boolean
  out_en: boolean
  pid_reset: boolean
  motorcurrent: single
  current_limiter: single, Unit="V"

PID = Simulink.Bus()
  type: Enum:ControlModes
  OutMax: single
  OutMin: single
  P: single
  I: single
  D: single
  N: single
  I0: single
  D0: single
  shift_factor: uint8

PIDsConfiguration = Simulink.Bus()
  currentPID: Bus: PID
  velocityPID: Bus: PID
  positionPID: Bus: PID

ActuatorConfiguration = Simulink.Bus()
  thresholds: Bus: Thresholds
  pids: Bus: PIDsConfiguration
  motor: Bus: MotorConfiguration

FOCSlowInputs = Simulink.Bus()
  global_configuration: Bus: GlobalConfiguration
  actuator_configuration: Bus: ActuatorConfiguration
  estimated_data: Bus: EstimatedData
  targets: Bus: Targets
  control_outer_outputs: Bus: ControlOuterOutputs

Temperature_estimation_switch = false
Ts_MotionController = 0.001
Ts_ControlOuter = 0.001
Ts_EstimationVelocity = 0.001
Ts_FilterCurrent = 0.001
Ts_Supervision = 0.001
Ts_ThermalModel = 0.01

MCVariants = Simulink.VariantConfigurationData(
  struct(
    Configurations=[struct(
      Name="Temperature_estimation_ON",
      Description="",
      ControlVariables=struct(Name="Temperature_estimation_switch", Value=true, Source="common.sldd")), struct(
      Name="Temperature_estimation_OFF",
      Description="",
      ControlVariables=struct(Name="Temperature_estimation_switch", Value=false, Source="common.sldd"))],
    VariantConfigurations=[struct(
      Name="Temperature_estimation_ON",
      Description="",
      ControlVariables=struct(Name="Temperature_estimation_switch", Value="true", Source="common.sldd"),
      SubModelConfigurations=[]), struct(
      Name="Temperature_estimation_OFF",
      Description="",
      ControlVariables=struct(Name="Temperature_estimation_switch", Value="false", Source="common.sldd"),
      SubModelConfigurations=[])],
    Constraints=[],
    PreferredConfiguration="Temperature_estimation_OFF",
    DefaultConfigurationName="",
    DataDictionaryName="common.sldd",
    DataDictionarySection="Configurations",
    AreSubModelConfigurationsMigrated=true,
    ComponentConfigurationData=[],
    Version="23.2"))

Ts_ControlFOC = 4.5e-5

HardwareFaults = Simulink.Bus()
  overcurrent: boolean

Thresholds = Simulink.Bus()
  jntVelMax: single, Min=0, Unit="deg/s"  % Can be only non-negative
  motorNominalCurrents: single, Min=0, Unit="A"  % Current that can be kept for an indefinite period of time w/o damaging the motor
    % Expressed in [A] as all the internal computations are done this way
    % Can be only non-negative
  motorPeakCurrents: single, Min=0, Unit="A"  % Current that can be applied for a short period of time
    % Expressed in [A] as all the internal computations are done this way
    % Can be only non-negative
  motorOverloadCurrents: single, Min=0, Unit="A"  % Currents over this threshold can instantaneously damages the motor
    % Expressed in [A] as all the internal computations are done this way
    % Can be only non-negative
  motorPwmLimit: uint32, Min=0, Unit="1"  % Expressed in ticks
    % Max value is 32000
    % Can be only non-negative
  motorCriticalTemperature: single, Unit="°C"  % The critical temperature of the motor that triggers i2t current protection.

SupervisorInputLimits = Simulink.Bus()
  overload: single
  peak: single
  nominal: single
  type: Enum: ControlModes

MotorConfigurationExternal = Simulink.Bus()
  enable_verbosity: boolean
  has_hall_sens: boolean
  has_quadrature_encoder: boolean
  has_speed_quadrature_encoder: boolean
  has_temperature_sens: boolean
  encoder_tolerance: uint8
  pole_pairs: uint8
  rotor_encoder_resolution: int16
  rotor_index_offset: int16
  use_index: boolean

ReceivedEvents = Simulink.Bus()
  motor_id: uint8
  event_type: Enum: EventTypes
  targets_content: Bus: Targets
  pid_content: Bus: PID
  control_mode_content: Enum: ControlModes
  limits_content: Bus: SupervisorInputLimits
  motor_config_content: Bus: MotorConfigurationExternal

MAX_EVENTS_PER_TICK = int32(4)

BUS_MSG_STATUS = Simulink.Bus()
  control_mode: Enum: MCControlModes
  pwm_fbk: single, Min=-100, Max=100, Unit="%"  % control effort (quadrature)
  flags: Bus: BUS_FLAGS_TX

BUS_STATUS_TX = Simulink.Bus()  % Aggregate of all events specifying types of transmitted messages.
  foc: boolean
  status: boolean

BUS_MSG_FOC = Simulink.Bus()  % Fields of a FOC message.
  current: single, Unit="A"  % Current feedback in A.
  position: single, Unit="deg"  % Position feedback in deg.
  velocity: single, Unit="deg/s"  % Velocity feedback in deg/s.

BUS_FLAGS_TX = Simulink.Bus()
  dirty: boolean
  stuck: boolean
  index_broken: boolean
  phase_broken: boolean
  not_calibrated: single
  ExternalFaultAsserted: boolean
  UnderVoltageFailure: boolean
  OverVoltageFailure: boolean
  OverCurrentFailure: boolean
  DHESInvalidValue: boolean
  AS5045CSumError: boolean
  DHESInvalidSequence: boolean
  CANInvalidProtocol: boolean
  CAN_BufferOverRun: boolean
  SetpointExpired: boolean
  CAN_TXIsPasv: boolean
  CAN_RXIsPasv: boolean
  CAN_IsWarnTX: boolean
  CAN_IsWarnRX: boolean
  OverHeating: boolean
  ADCCalFailure: boolean
  I2TFailure: boolean
  EMUROMFault: boolean
  EMUROMCRCFault: boolean
  EncoderFault: boolean
  FirmwareSPITimingError: boolean
  AS5045CalcError: boolean
  FirmwarePWMFatalError: boolean
  CAN_TXWasPasv: boolean
  CAN_RXWasPasv: boolean
  CAN_RTRFlagActive: boolean
  CAN_WasWarn: boolean
  CAN_DLCError: boolean
  SiliconRevisionFault: boolean
  PositionLimitUpper: boolean
  PositionLimitLower: boolean

BUS_MESSAGES_TX = Simulink.Bus()  % Aggregate of all CAN transmitted messages.
  foc: Bus: BUS_MSG_FOC
  status: Bus: BUS_MSG_STATUS

Ts_SupervisorFSM_TX = 0.001

JointData = Simulink.Bus()
  position: single, Unit="deg"  % position encoder after gearbox

EstimatedData = Simulink.Bus()
  rotor_velocity: single  % velocity
  Iq_filtered: single  % filtered motor current
  motor_temperature: single  % motor temperature
  joint_velocity: single  % velocity

MotorConfiguration = Simulink.Bus()
  externals: Bus: MotorConfigurationExternal
  Kbemf: single
  Rphase: single
  Imin: single, Unit="A"
  Imax: single, Unit="A"
  Vmax: single, Unit="V"
  resistance: single, Unit="Ohm"
  inductance: single, Unit="uH"
  thermal_resistance: single, Unit="K/W"
  thermal_time_constant: single, Unit="s"
  hall_sensors_offset: single, Unit="deg"
  reference_encoder: Enum: ReferenceEncoder

EstimationConfiguration = Simulink.Bus()
  environment_temperature: single
  current_rms_lambda: single
  velocity_est_mode: Enum: EstimationVelocityModes
  velocity_est_window: uint32

Flags = Simulink.Bus()
  calibration_type: Enum: CalibrationTypes  % Flag that shows if:
    % 0. None calibration
    % 1. Search Index must be done
    % 2. Full calibration must be done
  calibration_done: boolean
  enable_sending_msg_status: boolean
  hw_faults: Bus: HardwareFaults
  enable_thermal_protection: boolean
  control_mode: Enum: ControlModes  % control mode

FOCOutputs = Simulink.Bus()
  Vq: single, Min=-100, Max=100, Unit="%"  % control effort (quadrature)
  Vabc: single[3], Min=0, Max=100, Unit="%"  % control effort (3-phases)
  Iq_fbk: single  % quadrature current
  Id_fbk: single  % direct current
  Iq_rms: single  % RMS of Iq
  Id_rms: single  % RMS of Id

Targets = Simulink.Bus(DataScope="Exported")
  trajectory_time: single, Unit="s"  % Target time for position control
  position: single
  velocity: single
  current: single
  voltage: single

MCConfiguration = Simulink.ConfigSet(StartTime="0", StopTime="20", Solver="FixedStepDiscrete", ProdHWDeviceType="ARM Compatible->ARM Cortex-M", SystemTargetFile="ert.tlc", TargetLang="C++")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

sensors_service = Simulink.ServiceBus()
  decode: Sensors = decode(), Asynchronous=false, Arguments=Simulink.BusElement(Name="Sensors", DataType="Bus: SensorsData")

SensorsData = Simulink.Bus(DataScope="Exported")
  driversensors: Bus: DriverSensors
  motorsensors: Bus: MotorSensors

DriverSensors = Simulink.Bus(DataScope="Exported")
  Vcc: single, Unit="V"  % power supply voltage

MotorSensors = Simulink.Bus(DataScope="Exported")
  qencoder: Bus: QuadratureEncoder
  Iabc: single[3], Unit="A"
  electrical_angle: single, Unit="deg"  % electrical angle = angle * pole_pairs
  temperature: single, Unit="degC"
  voltage: single, Unit="V"
  current: single, Unit="A"
  hallABC: uint8

QuadratureEncoder = Simulink.Bus(DataScope="Exported")
  offset: single  % Offset of the rotor-stator calibration, difference angle between the 0 of the sensors(index) and the electrical zero
  rotor_angle: single, Unit="deg"  % Mechanical Angle before gearbox
  counter: single  % Counter of the QENC
  Idx_counter: single  % Last QENC count where the index has been detected

planner_service = Simulink.ServiceBus()
  get: PlannedTargets = get(), Asynchronous=false, Arguments=Simulink.BusElement(Name="PlannedTargets", DataType="Bus: Targets")

cascade_service = Simulink.ServiceBus()
  get: Outputs = get(), Asynchronous=false, Arguments=Simulink.BusElement(Name="Outputs", DataType="Bus: ControlOuterOutputs")