% Simulink data dictionary MotionController.sldd

CTRL_LOOP_PERIOD = 0.001
velAvg = Simulink.Parameter(2, DataType="single")
Ts = 0.001
MCConfiguration = Simulink.ConfigSet(StartTime="0", StopTime="1", FixedStep="0.001", Solver="FixedStepDiscrete", ProdHWDeviceType="ARM Compatible->ARM Cortex-M", SystemTargetFile="ert.tlc", TargetLang="C++")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

trajectoryhidParameters = Simulink.Bus()
  pos_min: single
  pos_max: single
  vel_max: single
  acc_max: single
  target_pos: single
  xX: single
  xV: single
  xA: single
  xT: single
  xTimer: single
  bVelocityMove: boolean
  target_vel: single
  vX: single
  vV: single
  vA: single
  vT: single
  vTimer: single
  vInvT: single
  xK0: single
  xK1: single
  xK2: single
  xK3: single
  xK4: single
  xK5: single
  vK0: single
  vK1: single
  vK2: single
  vK3: single
  vK4: single
  vK5: single
  vK6: single

InitTrajectory = struct(
  pos_min=single(0),
  pos_max=single(0),
  vel_max=single(0),
  acc_max=single(0),
  target_pos=single(0),
  xX=single(0),
  xV=single(0),
  xA=single(0),
  xT=single(0),
  xTimer=single(0),
  bVelocityMove=false,
  target_vel=single(0),
  vX=single(0),
  vV=single(0),
  vA=single(0),
  vT=single(0),
  vTimer=single(0),
  vInvT=single(0),
  xK0=single(0),
  xK1=single(0),
  xK2=single(0),
  xK3=single(0),
  xK4=single(0),
  xK5=single(0),
  vK0=single(0),
  vK1=single(0),
  vK2=single(0),
  vK3=single(0),
  vK4=single(0),
  vK5=single(0),
  vK6=single(0))